# Grasshopper definition spiral_cup.gh (Grasshopper 1.0.7)

bump_height = Slider(1, range=0..10)
layer_height = Slider(18, range=0..100)
bump_width = Slider(6, range=5..20)
radius = Slider(31, range=0..100)
offset = Slider(10, range=0..100)
python = GhPythonScript()  # -> out, file
# ---------- python: Python ----------
import rhinoscriptsyntax as rs
#Create a new file
filter = "GCode (*.gcode)|*.gcode|All Files (*.*)|*.*||"
file = rs.SaveFileName("", filter)
# ---------- end python ----------
list = ValueList({"Square", "Triangle", "Loop"}, selected="Square")
panel = Panel(python.file)
python_2 = GhPythonScript(
    filename=python.file,
    radius=radius,
    layer_height=layer_height,
    offset=offset,
    bump_width=bump_width,
    bump_height=bump_height,
    shape_type=list)  # -> out, lines, turtle; inputs radius: Int32, layer_height: Int32, offset: Int32, bump_width: Int32, bump_height: Int32
# ---------- python_2: Python ----------
import rhinoscriptsyntax as rs
import sys
import math
import operator as op
import extruder_turtle
from extruder_turtle import *
from spiral_cup import SpiralCup   # file

to_delete = list()
for module in sys.modules:
    if "spiral_cup" in module:
      to_delete.append(module)
for module in to_delete:
    sys.modules.pop(module)
    
t = ExtruderTurtle()
t.setup(x=0, y=0, z=0, filename=filename, printer = "eazao")
t.set_extrude_rate(.8) # change extrude rate
t.set_extrude_width(1.5) # change extrude width
extrude_width = t.get_extrude_width()

# angle = 0
# increment_angle = 1  # degrees, smaller value makes spiral smoother
# total_rotations = radius / extrude_width  # total rotations in the spiral

# while angle <= 360 * total_rotations: # keep going until we've done the total rotations
    # curr_radius = angle * extrude_width / 360  # current radius based on angle
    # x = curr_radius * math.cos(math.radians(angle))
    # y = curr_radius * math.sin(math.radians(angle))
    # t.set_position(x, y)
    # angle += increment_angle
    
s = SpiralCup(t)
t = s.bump(layer_height, radius, bump_height, bump_width, offset, shape_type)

lines = t.get_lines()
t.finish()
# ---------- end python_2 ----------
